# Dynamo graph Ifc-PSetRemoval-Save.dyn (Dynamo 2.5.0.7186)
# packages: BitubIFC 0.1.0

code_block = CodeBlock { "Other"; }
ifc_authormetadata = IfcAuthorMetadataNodeModel(OrganisationName="The unknown", OrganisationAddress="Somewhere")
code_block_2 = CodeBlock { "Changed"; }
file_path = Filename("C:\Workspace\Git\BitubTRexDynamo\BitubIfc.Examples\Ifc4\IfcSampleHouse.ifc")
file_path_2 = Filename("C:\Workspace\Git\BitubTRexDynamo\BitubIfc.Examples\Out\Log.log")
file_logger = FileLog(fileName=file_path_2, LogEventLevel=1)
ifc_load = IfcLoadStoreNodeModel(fileName=file_path, logger=file_logger, IsCancelable=true)  # unwired: prefs
ifc_psetremoval = IfcPSetRemovalTransformNodeModel(removePSetNames=code_block, authorMetadata=ifc_authormetadata, canonicalName=code_block_2, ifcModel=ifc_load, IsCancelable=true)
canonicalName = Store.IfcModel.CanonicalName(ifcModel=ifc_psetremoval)
directory_path = Directory("C:\Workspace\Git\BitubTRexDynamo\BitubIfc.Examples\Out")
relocatePath = Store.IfcModel.RelocatePath(ifcModel=ifc_psetremoval, newPathName=directory_path)
ifc_save = IfcSaveStoreNodeModel(ifcModel=relocatePath, SelectedOption="ifczip", IsCancelable=true)  # unwired: separator
propertySetNames = Store.IfcModel.PropertySetNames(ifcModel=ifc_load)
logMessages = Store.IfcModel.LogMessages(ifcModel=ifc_load)
toData = Log.LogMessage.ToData(logMessages=logMessages)
