# Dynamo graph IfcLoad-And-Evaluate.dyn "BitubTRex-Single-IFC-Load" (Dynamo 2.5.0.7186)
# packages: TRexIFC 0.1.0

file_path = Filename("C:\Workspace\Git\BitubTRexDynamo\BitubIfc.Examples\Ifc4\IfcSampleHouse.ifc")
file_path_2 = Filename("C:\Workspace\Git\BitubTRexDynamo\BitubIfc.Examples\Out\Single-IFC-Load.log")
fileLog = FileLog(fileName=file_path_2, LogEventLevel=0)
ifc_load = IfcStoreNodeModel(fileName=file_path, logger=fileLog, IsCancelable=true)
projectName = Store.IfcStore.ProjectName(ifcStore=ifc_load)
watch = Watch(projectName)
listProductTypes = Store.IfcStore.ListProductTypes(ifcStore=ifc_load)
watch_2 = Watch(listProductTypes)
schema = Store.IfcStore.Schema(ifcStore=ifc_load)
watch_3 = Watch(schema)
fileName = Store.IfcStore.FileName(ifcStore=ifc_load)
watch_4 = Watch(fileName)
directory_path = Directory("C:\Workspace\Git\BitubTRexDynamo\BitubIfc.Examples\Out")
relocate = Store.IfcStore.Relocate(ifcStore=ifc_load, pathName=directory_path)
ifc_save = IfcSaveStoreNodeModel(store=relocate, SelectedOption=".ifczip", IsCancelable=true)
watch_5 = Watch(ifc_save)
listOwnerHistory = Store.IfcMetadata.ListOwnerHistory(ifcStore=ifc_load)
toData = Store.IfcMetadata.ToData(ifcMetadata=listOwnerHistory)
