# Dynamo graph IfcLoad-And-SceneExport.dyn (Dynamo 2.5.0.7186)
# packages: TRexIFC 0.1.0

code_block = CodeBlock { 1; 2; 4; }
byCoordinates = Geom.XYZ.ByCoordinates(x=code_block.out0, y=code_block.out1, z=code_block.out2)
code_block_2 = CodeBlock { 1.0; }
code_block_3 = CodeBlock()
# ---------- code_block_3.designscript (2 lines) ----------
["Body",
"Model","e"];
# ----------------------------------------
scene_export_settings = SceneExportSettingsNodeModel(offset=byCoordinates, unitsPerMeter=code_block_2, providedContexts=code_block_3, ProvidedGraphicalContext=["Body", "Model"], SelectedGraphicalContext=["Body"], TransformationStrategy=0, PositioningStrategy=1)
offset = Export.SceneExportSettings.Offset(sceneExportSettings=scene_export_settings)
positioningStrategy = Export.SceneExportSettings.PositioningStrategy(sceneExportSettings=scene_export_settings)
transformationStrategy = Export.SceneExportSettings.TransformationStrategy(sceneExportSettings=scene_export_settings)
unitsPerMeter = Export.SceneExportSettings.UnitsPerMeter(sceneExportSettings=scene_export_settings)
sceneContexts = Export.SceneExportSettings.SceneContexts(sceneExportSettings=scene_export_settings)
file_path = Filename("C:\Workspace\Git\BitubTRexDynamo\BitubIfc.Examples\Ifc4\IfcSampleHouse.ifc")
file_path_2 = Filename("C:\Workspace\Git\BitubTRexDynamo\BitubIfc.Examples\Out\Single-IFC-Load.log")
fileLog = FileLog(fileName=file_path_2, LogEventLevel=1)
ifc_load = IfcStoreNodeModel(fileName=file_path, logger=fileLog, IsCancelable=true)
scene_export = SceneExporterNodeModel(setting=scene_export_settings, storeProducer=ifc_load, SelectedOption=".json", IsCancelable=true)  # unwired: pathName
directory_path = Directory("C:\Workspace\Git\BitubTRexDynamo\BitubIfc.Examples\Out")
