# Dynamo graph IfcLoad-Evaluate.dyn (Dynamo 2.5.0.7186)
# packages: BitubIFC 0.1.0

file_path = Filename("C:\Workspace\Git\BitubTRexDynamo\BitubIfc.Examples\Ifc4\IfcSampleHouse.ifc")
file_path_2 = Filename("C:\Workspace\Git\BitubTRexDynamo\BitubIfc.Examples\Out\Log.log")
file_logger = FileLog(fileName=file_path_2, LogEventLevel=1)
ifc_load = IfcLoadStoreNodeModel(fileName=file_path, logger=file_logger, IsCancelable=true)
schema = Store.IfcModel.Schema(ifcModel=ifc_load)
name = Store.IfcModel.Name(ifcModel=ifc_load)
