# Dynamo graph IfcSequentialLoad-And-Evaluate.dyn (Dynamo 2.5.0.7186)
# packages: TRexIFC 0.1.0

directory_path = Directory("C:\Workspace\Git\BitubTRexDynamo\BitubIfc.Examples\Ifc4")
file_path = Filename("C:\Workspace\Git\BitubTRexDynamo\BitubIfc.Examples\Out\Sequential-IFC-Load.log")
file_logger = FileLog(fileName=file_path, LogEventLevel=1)
ifc_sequential_load = IfcStoreProducerNodeModel(fileNames=directory_path, logger=file_logger, IsCancelable=true)
code_block = CodeBlock { "-1"; }
ifc_sequential_save = IfcSaveStoreProceduralNodeModel(suffix=code_block, IsCancelable=true)  # unwired: storeProducer, replaceWith, replacePattern
directory_path_2 = Directory("C:\Workspace\Git\BitubTRexDynamo\BitubIfc.Examples\Out")
schema = Store.IfcStore.Schema()  # unwired: ifcStore
