# Dynamo graph IfcSequentialLoad-And-Export.dyn (Dynamo 2.5.0.7186)
# packages: TRexIFC 0.1.0

directory_path = Directory("C:\Workspace\Git\BitubTRexDynamo\BitubIfc.Examples\Out")
code_block = CodeBlock { 0; 0; 0; }
byXYZ = Geom.XYZ.ByXYZ(x=code_block.out0, y=code_block.out1, z=code_block.out2)
code_block_2 = CodeBlock { 1.0; }
code_block_3 = CodeBlock { "Body"; }
scene_export_settings = SceneExportSettingsNodeModel(offset=byXYZ, unitsPerMeter=code_block_2, sceneContexts=code_block_3, UnitsPerMeter=1, TransformationStrategy=0, PositioningStrategy=0)
directory_path_2 = Directory("C:\Workspace\Git\BitubTRexDynamo\BitubIfc.Examples\Ifc4")
directory_from_path = DirectoryObject(path=directory_path_2)
code_block_4 = CodeBlock { "*.ifc"; }
getDirectoryContents = FileSystem.GetDirectoryContents(directory=directory_from_path, searchString=code_block_4)
file_path = Filename("C:\Workspace\Git\BitubTRexDynamo\BitubIfc.Examples\Out\Sequential-IFC-Load.log")
file_logger = FileLog(fileName=file_path, LogEventLevel=1)
ifc_sequential_load = IfcStoreProducerNodeModel(fileNames=getDirectoryContents.files, logger=file_logger, IsCancelable=true)
scene_export = SceneExporterNodeModel(setting=scene_export_settings, storeProducer=ifc_sequential_load, SelectedOption=".json", IsCancelable=true)
