# Dynamo graph Home1.dyn (Dynamo 2.6.0.8481)
# packages: TRexIfc 0.1.0.0

code_block = CodeBlock { ["Test",1,"A"]; }
select_items_from = SelectiveItemListNodeModel(items=code_block)
watch = Watch(select_items_from)
