# Dynamo graph Ifc-AlignAndRotate.dyn (Dynamo 2.12.0.5650)
# packages: TRex 1.0.21239.39945

# group: Rotation by 45°
new_x_axis_at_45 = CodeBlock { 1; 1; 0; }
byXYZ = TRex.Geom.XYZs.ByXYZ(x=new_x_axis_at_45.out0, y=new_x_axis_at_45.out1, z=new_x_axis_at_45.out2)
byXYRotation = TRex.Geom.Alignment.ByXYRotation(xAxis=byXYZ)

# group: IfcOwnerHistory template
code_block = CodeBlock { "One"; "Some"; }
byAuthor = TRex.Store.IfcAuthorMetadata.ByAuthor(newEditorName=code_block.out0, newGivenName=code_block.out1)

# group: File logger
file_path = Filename("Out\Ifc-AlignAndRotate.log")
file_logger = FileLog(fileName=file_path, LogEventLevel=1)

# group: Load IFC
file_path_2 = Filename("Ifc4\IfcSampleHouse.ifc")
ifc_load = IfcLoadStoreNodeModel(fileName=file_path_2, logger=file_logger, IsCancelable=true)  # unwired: prefs

# group: Transform IFC model
code_block_2 = CodeBlock { "(Aligned)"; }
log_reason = LogReasonComposingNodeModel(Selected=[16, 64])
ifc_axis_alignment = IfcAxisAlignmentTransformNodeModel(alignment=byXYRotation, author=byAuthor, nameAddon=code_block_2, logFilter=log_reason, ifcModel=ifc_load, Selected="Change existing placements", IsCancelable=true)

code_block_3 = CodeBlock { " "; }

# group: Export new IFC
directory_path = Directory(".\Out")
relocatePath = TRex.Store.IfcModel.RelocatePath(ifcModel=ifc_axis_alignment, newPathName=directory_path)
ifc_save = IfcSaveStoreNodeModel(ifcModel=relocatePath, separator=code_block_3, Selected="ifc", IsCancelable=true)

# group: Logging
log_filter = LogFilterNodeModel(model=ifc_save, LogCount=10, LogMinSeverity=0)  # unwired: mask
data_preview = DataTablePreviewNodeModel(in=log_filter, MinCount=1, MaxCount=100, Count=10)
