# Dynamo graph Ifc-AlignByAxis.dyn (Dynamo 2.12.0.5650)
# packages: TRex 1.0.20304.44022, TRex 1.0.21239.39970

# group: Offset shift and rotation by 45 degree
current_offset = CodeBlock { 9.2348486328125; 2.74641772460938; 0; }
byXYZ = TRex.Geom.XYZs.ByXYZ(x=current_offset.out0, y=current_offset.out1, z=current_offset.out2)
x_axis_source = CodeBlock { 1; 0; 0; }
byXYZ_2 = TRex.Geom.XYZs.ByXYZ(x=x_axis_source.out0, y=x_axis_source.out1, z=x_axis_source.out2)
target_offset = CodeBlock { 0; 0; 0; }
byXYZ_3 = TRex.Geom.XYZs.ByXYZ(x=target_offset.out0, y=target_offset.out1, z=target_offset.out2)
x_axis_target = CodeBlock { 0; 1; 0; }
byXYZ_4 = TRex.Geom.XYZs.ByXYZ(x=x_axis_target.out0, y=x_axis_target.out1, z=x_axis_target.out2)
by2x2Reference = TRex.Geom.Alignment.ByPointReference(offsetA=byXYZ, axisRefA=byXYZ_2, offsetB=byXYZ_3, axisRefB=byXYZ_4)  # "Alignment.By2x2Reference"
file_path = Filename("Out\Alignment-Full.xml")
saveTo = TRex.Geom.Alignment.SaveTo(alignment=by2x2Reference, fileName=file_path)

# group: IfcOwnerHistory template
code_block = CodeBlock { "One"; "Some"; }
byAuthor = TRex.Store.IfcAuthorMetadata.ByAuthor(newEditorName=code_block.out0, newGivenName=code_block.out1)

# group: File logger
file_path_2 = Filename("Out\Ifc-AlignByAxis.log")
file_logger = FileLog(fileName=file_path_2, LogEventLevel=1)

# group: Load IFC model
file_path_3 = Filename("Ifc4\IfcSampleHouse.ifc")
ifc_load = IfcLoadStoreNodeModel(fileName=file_path_3, logger=file_logger, IsCancelable=true)  # unwired: prefs

# group: Transform IFC model
code_block_2 = CodeBlock { "(AlignByAxis)"; }
log_reason = LogReasonComposingNodeModel(Selected=[16, 64])
ifc_axis_alignment = IfcAxisAlignmentTransformNodeModel(alignment=by2x2Reference, author=byAuthor, nameAddon=code_block_2, logFilter=log_reason, ifcModel=ifc_load, Selected="Change existing placements", IsCancelable=true)

# group: Save new IFC model
directory_path = Directory(".\Out")
relocatePath = TRex.Store.IfcModel.RelocatePath(ifcModel=ifc_axis_alignment, newPathName=directory_path)
code_block_3 = CodeBlock { " "; }
ifc_save = IfcSaveStoreNodeModel(ifcModel=relocatePath, separator=code_block_3, Selected="ifc", IsCancelable=true)

# group: Logging output
log_filter = LogFilterNodeModel(model=ifc_axis_alignment, LogCount=10, LogMinSeverity=0)  # unwired: mask
data_preview = DataTablePreviewNodeModel(in=log_filter, MinCount=1, MaxCount=100, Count=10)
