# Dynamo graph Ifc-Map-Projection-Example.dyn (Dynamo 3.5.1.8731)
# packages: TRex 1.0.0.0

# group: Load Ifc model with logger
file_path = Filename(".\Ifc4\IfcSampleHouse.ifc")
file_path_2 = Filename(".\Out\Ifc4-Map-Conversion.log")
file_logger = FileLog(fileName=file_path_2, LogEventLevel=1)
ifc_load = IfcLoadStoreNodeModel(fileName=file_path, logger=file_logger, IsCancelable=true)  # unwired: prefs

# group: Editor's prefs
editor_s_info = CodeBlock { "Name"; "Organization"; "Orga"; "Abc 123"; }
byAuthorAndOrganisation = TRex.Store.IfcAuthorMetadata.ByAuthorAndOrganisation(name=editor_s_info.out0, givenName=editor_s_info.out0, organisationName=editor_s_info.out1, organisationID=editor_s_info.out2, address=editor_s_info.out3)

# group: Custom addon offset
additonal_offset_height = CodeBlock { 0; 0; 0; }
byXYZ = TRex.Geom.XYZs.ByXYZ(x=additonal_offset_height.out0, y=additonal_offset_height.out1, z=additonal_offset_height.out2)

# group: Rotation property
rotation_ccw = CodeBlock { 45; }
byDEG = TRex.Geom.UVs.ByDEG(angle=rotation_ccw)

# group: Map transform & prefs
ifc_map_conversion = MapConversionModel(MapUnitScales=[{Prefix: null, UnitPrefixName: "Meter"}, {Prefix: 5, UnitPrefixName: "Kilometer"}, {Prefix: 9, UnitPrefixName: "Centimeter"}, {Prefix: 10, UnitPrefixName: "Millimeter"}], NameOfProjectedCRS="EPSG:25832", GeodeticDatumOfProjectedCRS="ETRS89", MapProjectionOfProjectedCRS="UTM", MapZoneOfProjectedCRS="UTM32", MapUnitPrefixOfProjectedCRS={Prefix: null, UnitPrefixName: "Meter"}, UseLocalOffsetConversion=false)
graphicalContexts = TRex.Store.IfcModel.GraphicalContexts(ifcModel=ifc_load)
select_items_from = SelectingItemListNodeModel(items=graphicalContexts, SelectedValue=["Body"])
scale_on_target_crs = CodeBlock { 1.0; }
name_addon = CodeBlock { "(final)"; }
ifc_map_conversion_transform = MapConversionTransformNodeModel(ifcModel=ifc_load, ifcAuthor=byAuthorAndOrganisation, convPrefs=ifc_map_conversion, contexts=select_items_from, offset=byXYZ, xAxis=byDEG, scale=scale_on_target_crs, nameAddon=name_addon, IsCancelable=true)

# group: Save Ifc model
directory_path = Directory(".\Out")
relocatePath = TRex.Store.IfcModel.RelocatePath(ifcModel=ifc_map_conversion_transform, newPathName=directory_path)
ifc_save = IfcSaveStoreNodeModel(ifcModel=relocatePath, Selected="ifc", IsCancelable=true)  # unwired: separator

# group: Logging output
log_filter = LogFilterNodeModel(model=ifc_save, LogCount=10, LogMinSeverity=0)  # unwired: mask
data_preview = DataTablePreviewNodeModel(in=log_filter, MinCount=1, MaxCount=100, Count=10)
