# Dynamo graph Ifc-PropertySet-Removal.dyn (Dynamo 2.12.0.5650)
# packages: TRex 1.0.21239.39949

# group: IfcOwnerHistory Template
ifc_authormetadata = IfcAuthorMetadataNodeModel()

# group: Explicitely define include property sets
code_block = CodeBlock { ["Other"]; }

# group: File logger
file_path = Filename("Out\Ifc-PropertySet-Removal.log")
file_logger = FileLog(fileName=file_path, LogEventLevel=1)

# group: Load IFC
file_path_2 = Filename("Ifc4\IfcSampleHouse.ifc")
ifc_load = IfcLoadStoreNodeModel(fileName=file_path_2, logger=file_logger, IsCancelable=true)  # unwired: prefs

# group: or query propertyset names and select exclusive names
propertySetNames = TRex.Store.IfcModel.PropertySetNames(ifcModel=ifc_load)
exclude_items_from = ExcludingItemListNodeModel(items=propertySetNames, SelectedValue=["Other"])

# group: Transform IFC
workflow_name = CodeBlock { "(Cleaned up)"; }
log_reason = LogReasonComposingNodeModel(Selected=[16, 32])
ifc_propertyset_filter = IfcPSetRemovalTransformNodeModel(excludeSets=exclude_items_from, nameAddon=workflow_name, logFilter=log_reason, ifcModel=ifc_load, IsCancelable=true)  # unwired: includeSets

# group: Save IFC
propertySetNames_2 = TRex.Store.IfcModel.PropertySetNames(ifcModel=ifc_propertyset_filter)
directory_path = Directory(".\Out")
relocatePath = TRex.Store.IfcModel.RelocatePath(ifcModel=ifc_propertyset_filter, newPathName=directory_path)
code_block_2 = CodeBlock { " "; }
ifc_save = IfcSaveStoreNodeModel(ifcModel=relocatePath, separator=code_block_2, Selected="ifc", IsCancelable=true)

log_filter = LogFilterNodeModel(model=ifc_save, LogCount=45, LogMinSeverity=0)  # unwired: mask
data_preview = DataTablePreviewNodeModel(in=log_filter, MinCount=1, MaxCount=100, Count=10)
