# Dynamo graph Ifc-Representation-Refactoring.dyn (Dynamo 2.12.0.5650)
# packages: TRex 1.0.21239.39949

# group: File logger
file_path = Filename("Out\Ifc-Representation-Refactoring.log")
file_logger = FileLog(fileName=file_path, LogEventLevel=1)

# group: Load IFC
file_path_2 = Filename("Ifc4\IfcSampleHouse.ifc")
ifc_load = IfcLoadStoreNodeModel(fileName=file_path_2, logger=file_logger, IsCancelable=true)  # unwired: prefs

# group: Refactoring & decomposition of multi-body representations
graphicalContexts = TRex.Store.IfcModel.GraphicalContexts(ifcModel=ifc_load)
select_items_from = SelectingItemListNodeModel(items=graphicalContexts, SelectedValue=["Body"])
code_block = CodeBlock { "(Refactored)"; }
ifc_representation_refactor = IfcRepresentationRefactorTransformNodeModel(context=select_items_from, nameAddon=code_block, ifcModel=ifc_load, Selected={ID: "OptionDecomposeAllWithAssembly"}, IsCancelable=true)

# group: Save IFC
directory_path = Directory("Out")
relocatePath = TRex.Store.IfcModel.RelocatePath(ifcModel=ifc_representation_refactor, newPathName=directory_path)
code_block_2 = CodeBlock { " "; }
ifc_save = IfcSaveStoreNodeModel(ifcModel=relocatePath, separator=code_block_2, Selected="ifc", IsCancelable=true)
log_filter = LogFilterNodeModel(model=ifc_save, LogCount=10, LogMinSeverity=0)  # unwired: mask
data_preview = DataTablePreviewNodeModel(in=log_filter, MinCount=1, MaxCount=100, Count=10)
