# Dynamo graph Ifc-SceneExportWithAssimp.dyn (Dynamo 2.17.0.3472)
# packages: TRex 1.0.23107.65534

# group: File logger
file_path = Filename("Out\IfcLoad-SceneExport.log")
file_logger = FileLog(fileName=file_path, LogEventLevel=1)

# group: Load IFC
file_path_2 = Filename("Ifc4\IfcSampleHouse.ifc")
ifc_load = IfcLoadStoreNodeModel(fileName=file_path_2, logger=file_logger, IsCancelable=true)  # unwired: prefs

# group: Build component interim scene
crs_transform = CRSTransformNodeModel(Transform={SourceCRS: null, Transform: "{ \"r\": { \"rx\": { \"x\": 1, \"y\": 0, \"z\": 0 }, \"ry\": { \"x\": 0, \"y\": 1, \"z\": 0 }, \"rz\": { \"x\": 0, \"y\": 0, \"z\": 1 } }, \"t\": { \"x\": 0, \"y\": 0, \"z\": 0 } }", Name: "RHS Z-Up"})
unit_scale = UnitScaleNodeModel(SelectedUnitScale={UnitsPerMeter: 1, Name: "Meter", Reference: "m"})
graphicalContexts = TRex.Store.IfcModel.GraphicalContexts(ifcModel=ifc_load)
select_items_from = SelectingItemListNodeModel(items=graphicalContexts, SelectedValue=["Body"])
build_settings = SceneBuildSettingsNodeModel(crs=crs_transform, unitScale=unit_scale, context=select_items_from, TransformationStrategy=0, IdentificationStrategy=0, PositioningStrategy=0)  # unwired: offset
build_scene = SceneBuildNodeModel(settings=build_settings, ifcModel=ifc_load, IsCancelable=true)
code_block = CodeBlock { -9.23; -2.75; -0.47; }
byXYZ = TRex.Geom.XYZs.ByXYZ(x=code_block.out0, y=code_block.out1, z=code_block.out2)

# group: Relocate output
directory_path = Directory(".\Out")
relocatePath = TRex.Export.ComponentScene.RelocatePath(componentScene=build_scene, newPathName=directory_path)

# group: Export as FBX with Y axis up
unit_scale_2 = UnitScaleNodeModel(nested=unit_scale, SelectedUnitScale={UnitsPerMeter: 1, Name: "Meter", Reference: "m"})
crs_transform_2 = CRSTransformNodeModel(crs=crs_transform, Transform={SourceCRS: null, Transform: "{ \"r\": { \"rx\": { \"x\": 1, \"y\": 0, \"z\": 0 }, \"ry\": { \"x\": 0, \"y\": 0, \"z\": 1 }, \"rz\": { \"x\": 0, \"y\": -1, \"z\": 0 } }, \"t\": { \"x\": 0, \"y\": 0, \"z\": 0 } }", Name: "RHS Y-Up"})
export_scene_assimp = SceneExportNodeModel(scene=relocatePath, unitScale=unit_scale_2, crs=crs_transform_2, Selected={ID: "fbx", Extension: "fbx", Description: "Autodesk FBX (binary)"}, IsCancelable=false)

# group: Export as FBX with Y axis up > Logging output
log_filter = LogFilterNodeModel(model=export_scene_assimp, LogCount=10, LogMinSeverity=0)  # unwired: mask
data_preview = DataTablePreviewNodeModel(in=log_filter, MinCount=1, MaxCount=100, Count=10)

# group: JSON Export
save_scene = SceneSaveNodeModel(scene=relocatePath, Selected={ID: "json", Extension: "json", Description: "JSON Text"}, IsCancelable=false)  # unwired: separator

# group: JSON Export > Logging output
log_filter_2 = LogFilterNodeModel(model=save_scene, LogCount=10, LogMinSeverity=0)  # unwired: mask
data_preview_2 = DataTablePreviewNodeModel(in=log_filter_2, MinCount=1, MaxCount=100, Count=10)
