# Dynamo graph IfcExportSettings_Save.dyn (Dynamo 2.6.0.8481)
# packages: TRexIfc 0.1.0.0

code_block = CodeBlock { 0; 0; 0; }
byCoordinates = Geom.XYZ.ByCoordinates(x=code_block.out0, y=code_block.out1, z=code_block.out2)
code_block_2 = CodeBlock { "Body"; }
scene_export_settings = SceneExportSettingsNodeModel(offset=byCoordinates, providedContexts=code_block_2, ProvidedGraphicalContext=["Body"], SelectedGraphicalContext=["Body"], TransformationStrategy=0, PositioningStrategy=0)  # unwired: unitsPerMeter, logger
settings = Export.SceneExport.Settings(sceneExport=scene_export_settings)
file_path = Filename("Out\Example-Settings.xml")
saveAs = Export.SceneExportSettings.SaveAs(settings=settings, fileName=file_path)
