# Dynamo graph IfcLoad-Align-And-Rotate-Save.dyn (Dynamo 2.10.1.3976)
# packages: TRexIfc 1.0.20304.44022, TRex 1.0.21151.45191

# group: Rotation by 45°
new_x_axis_at_45 = CodeBlock { 1; 1; 0; }
byXYZ = TRex.Geom.XYZs.ByXYZ(x=new_x_axis_at_45.out0, y=new_x_axis_at_45.out1, z=new_x_axis_at_45.out2)
byXYRotation = TRex.Geom.Alignment.ByXYRotation(xAxis=byXYZ)

# group: IfcOwnerHistory template
code_block = CodeBlock { "One"; "Some"; }
byAuthor = TRex.Store.IfcAuthorMetadata.ByAuthor(newEditorName=code_block.out0, newGivenName=code_block.out1)

# group: File logger
file_path = Filename("Out\IfcLoad-Align-Save.log")
file_logger = FileLog(fileName=file_path, LogEventLevel=1)

# group: Load IFC
file_path_2 = Filename("Ifc4\IfcSampleHouse.ifc")
ifc_load = IfcLoadStoreNodeModel(fileName=file_path_2, logger=file_logger, IsCancelable=true)  # unwired: prefs

# group: Transform IFC model
code_block_2 = CodeBlock { "Aligned"; }
log_reason = LogReasonComposingNodeModel(Selected=[16, 64])
ifc_axis_alignment = IfcAxisAlignmentTransformNodeModel(alignment=byXYRotation, authorMetadata=byAuthor, canonicalName=code_block_2, ifcModel=ifc_load, logReasonFilter=log_reason, IsCancelable=true)

# group: Export new IFC
directory_path = Directory(".\Out")
relocatePath = TRex.Store.IfcModel.RelocatePath(ifcModel=ifc_axis_alignment, newPathName=directory_path)
ifc_save = IfcSaveStoreNodeModel(ifcModel=relocatePath, Selected="ifc", IsCancelable=true)  # unwired: separator

# group: Logging output
log_filter = LogFilterNodeModel(logSource=ifc_axis_alignment, LogCount=10, LogMinSeverity=0)  # unwired: logReason
data_preview = DataTablePreviewNodeModel(in=log_filter, MinCount=1, MaxCount=100, Count=10)
