# Dynamo graph IfcLoad-Align-Save.dyn (Dynamo 2.6.0.8481)
# packages: TRexIfc 0.1.0.0

code_block = CodeBlock { -9.2348486328125; -2.74641772460938; 0; }
byCoordinates = Geom.XYZ.ByCoordinates(x=code_block.out0, y=code_block.out1, z=code_block.out2)
code_block_2 = CodeBlock { 0; 0; 0; }
byCoordinates_2 = Geom.XYZ.ByCoordinates(x=code_block_2.out0, y=code_block_2.out1, z=code_block_2.out2)
byOffsetShift = Geom.Alignment.ByOffsetShift(offsetA=byCoordinates, offsetB=byCoordinates_2)
file_path = Filename("C:\Workspace\Git\BitubTRexDynamo\Examples\Out\Offset-Shift.xml")
saveTo = Geom.Alignment.SaveTo(alignment=byOffsetShift, fileName=file_path)
code_block_3 = CodeBlock { "One"; "Some"; }
byAuthor = Store.IfcAuthorMetadata.ByAuthor(newEditorName=code_block_3.out0, newGivenName=code_block_3.out1)
code_block_4 = CodeBlock { "Aligned"; }
file_path_2 = Filename("Ifc4\IfcSampleHouse.ifc")
file_path_3 = Filename("Out\IfcLoad-Align-Save.log")
file_logger = FileLog(fileName=file_path_3, LogEventLevel=1)
ifc_load = IfcLoadStoreNodeModel(fileName=file_path_2, logger=file_logger, IsCancelable=true)  # unwired: prefs
log_reason = LogReasonComposingNodeModel(Selected=[16, 64])
ifc_axis_alignment = IfcAxisAlignmentTransformNodeModel(alignment=byOffsetShift, authorMetadata=byAuthor, canonicalName=code_block_4, ifcModel=ifc_load, logReasonFilter=log_reason, SelectedOption="Insert new root placement", IsCancelable=true)
directory_path = Directory("C:\Workspace\Git\BitubTRexDynamo\Examples\Out")
relocatePath = Store.IfcModel.RelocatePath(ifcModel=ifc_axis_alignment, newPathName=directory_path)
ifc_save = IfcSaveStoreNodeModel(ifcModel=relocatePath, SelectedOption="ifc", IsCancelable=true)  # unwired: separator
log_filter = LogFilterNodeModel(logSource=ifc_axis_alignment, LogCount=10, LogMinSeverity=0)  # unwired: logReason
data_preview = DataTablePreviewNodeModel(in=log_filter, MinCount=1, MaxCount=100, Count=10)
