# Dynamo graph IfcLoad-AlignBy2By2-Save.dyn (Dynamo 2.6.1.8786)
# packages: TRexIfc 1.0.20304.44022

# group: Model CRS alignment
current_offset = CodeBlock { 9.2348486328125; 2.74641772460938; 0; }
byCoordinates = Geom.XYZ.ByCoordinates(x=current_offset.out0, y=current_offset.out1, z=current_offset.out2)
target_offset = CodeBlock { 0; 0; 0; }
byCoordinates_2 = Geom.XYZ.ByCoordinates(x=target_offset.out0, y=target_offset.out1, z=target_offset.out2)
x_axis_end = CodeBlock { 1; 0; 0; }
byCoordinates_3 = Geom.XYZ.ByCoordinates(x=x_axis_end.out0, y=x_axis_end.out1, z=x_axis_end.out2)
by2x2Reference = Geom.Alignment.By2x2Reference(offsetA=byCoordinates, offsetB=byCoordinates_2, endB=byCoordinates_3)  # unwired: endA
file_path = Filename("Out\Alignment-Full.xml")
saveTo = Geom.Alignment.SaveTo(alignment=by2x2Reference, fileName=file_path)

# group: IfcOwnerHistory template
code_block = CodeBlock { "One"; "Some"; }
byAuthor = Store.IfcAuthorMetadata.ByAuthor(newEditorName=code_block.out0, newGivenName=code_block.out1)

# group: File logger
file_path_2 = Filename("Out\IfcLoad-Align-Save.log")
file_logger = FileLog(fileName=file_path_2, LogEventLevel=1)

# group: Load IFC model
file_path_3 = Filename("Ifc4\IfcSampleHouse.ifc")
ifc_load = IfcLoadStoreNodeModel(fileName=file_path_3, logger=file_logger, IsCancelable=true)  # unwired: prefs

# group: Transform IFC model
code_block_2 = CodeBlock { "Aligned"; }
log_reason = LogReasonComposingNodeModel(Selected=[16, 64])
ifc_axis_alignment = IfcAxisAlignmentTransformNodeModel(alignment=by2x2Reference, authorMetadata=byAuthor, canonicalName=code_block_2, ifcModel=ifc_load, logReasonFilter=log_reason, SelectedOption="Change existing placements", IsCancelable=true)

# group: Save new IFC model
directory_path = Directory(".\Out")
relocatePath = Store.IfcModel.RelocatePath(ifcModel=ifc_axis_alignment, newPathName=directory_path)
ifc_save = IfcSaveStoreNodeModel(ifcModel=relocatePath, SelectedOption="ifc", IsCancelable=true)  # unwired: separator

# group: Logging output
log_filter = LogFilterNodeModel(logSource=ifc_axis_alignment, LogCount=10, LogMinSeverity=0)  # unwired: logReason
data_preview = DataTablePreviewNodeModel(in=log_filter, MinCount=1, MaxCount=100, Count=10)
