# Dynamo graph IfcLoad-CheckGuids-SaveReport.dyn (Dynamo 2.16.0.2501)
# packages: TRexIfc 1.1.0.0

file_path = Filename("Ifc4\IfcSampleHouse.ifc")
file_path_2 = Filename("Out\IfcLoad-CheckGuids-SaveReport.log")
file_logger = FileLog(fileName=file_path_2, LogEventLevel=1)
ifc_load = IfcLoadStoreNodeModel(fileName=file_path, logger=file_logger, IsCancelable=true)  # unwired: prefs
byEmptyStore = TRex.Validation.IfcGuidStore.ByEmptyStore()
ifcguid_validation = IfcGuidCheckValidationNodeModel(ifcModel=ifc_load, guidStore=byEmptyStore, IsCancelable=true)
ifcGuidStore = TRex.Validation.IfcGuidCheckResult.IfcGuidStore(ifcGuidCheckResult=ifcguid_validation)
countInstances = TRex.Validation.IfcGuidStore.CountInstances(ifcGuidStore=ifcGuidStore)
duplicateUsageCountInstances = TRex.Validation.IfcGuidStore.DuplicateUsageCountInstances(ifcGuidStore=ifcGuidStore)
toDataOfDuplicateUsage = TRex.Validation.IfcGuidStore.ToDataOfDuplicateUsage(ifcGuidStore=ifcGuidStore)
file_path_3 = Filename("Out\IfcLoad-CheckGuids-SaveReport.xlsx")
now = DateTime.Now()
code_block = CodeBlock { "yyyy-MM-dd-HHmmss"; }
format = DateTime.Format(dateTime=now, format=code_block)
ifcreport_domain = IfcReportDomainComposingNodeModel(Selected=[1, 14])
messages = TRex.Validation.IfcValidationResult.Messages(ifcValidationResult=ifcguid_validation, reportFilter=ifcreport_domain)
toData = TRex.Validation.IfcValidationMessage.ToData(ifcValidationMessage=messages)
code_block_2 = CodeBlock { 0; 0; }
openXMLExportExcel = Data.OpenXMLExportExcel(filePath=file_path_3, sheetName=format, data=toData, startRow=code_block_2.out0, startColumn=code_block_2.out1)
