# Dynamo graph IfcLoad-PSetRemoval-Save.dyn (Dynamo 2.6.1.8786)
# packages: TRexIfc 1.0.20304.44022, TRexIfc 1.0.21033.4264

# group: File logger
file_path = Filename("Out\IfcLoad-PSetRemoval-Save.log")
file_logger = FileLog(fileName=file_path, LogEventLevel=1)

# group: Load IFC
file_path_2 = Filename("Ifc4\IfcSampleHouse.ifc")
ifc_load = IfcLoadStoreNodeModel(fileName=file_path_2, logger=file_logger, IsCancelable=true)  # unwired: prefs

# group: Query propertyset names and select exclusive names
propertySetNames = TRex.Store.IfcModel.PropertySetNames(ifcModel=ifc_load)
exclude_items_from = ExcludingItemListNodeModel(items=propertySetNames, SelectedValue=["Identity Data"])

# group: IfcOwnerHistory Template
ifc_authormetadata = IfcAuthorMetadataNodeModel(OrganisationId="Self employed", OrganisationName="The unknown", AuthorName="Nobody", AuthorGivenName="Mr", OrganisationAddress="Somewhere")

# group: Property set filter transform
workflow_name = CodeBlock { "Cleanup"; }
log_reason = LogReasonComposingNodeModel(Selected=[16, 32, 64])
ifc_pset_filter = IfcPSetRemovalTransformNodeModel(excludeNames=exclude_items_from, authorMetadata=ifc_authormetadata, canonicalName=workflow_name, ifcModel=ifc_load, logReasonFilter=log_reason, IsCancelable=true)  # unwired: includeNames

# group: Save new cleaned IFC
directory_path = Directory(".\Out")
relocatePath = TRex.Store.IfcModel.RelocatePath(ifcModel=ifc_pset_filter, newPathName=directory_path)
code_block = CodeBlock { "-"; }
ifc_save = IfcSaveStoreNodeModel(ifcModel=relocatePath, separator=code_block, Selected="ifc", IsCancelable=true)

# group: Logging to Excel
file_path_3 = Filename("Out\IfcSampleHouse-Cleanup.xlsx")
canonicalName = TRex.Store.IfcModel.CanonicalName(ifcModel=ifc_pset_filter)
code_block_2 = CodeBlock { 0; 0; }
log_filter = LogFilterNodeModel(logSource=ifc_pset_filter, logReason=log_reason, LogCount=55, LogMinSeverity=0)
data_preview = DataTablePreviewNodeModel(in=log_filter, MinCount=1, MaxCount=100, Count=10)
exportExcel = Data.ExportExcel(filePath=file_path_3, sheetName=canonicalName, startRow=code_block_2.out0, startCol=code_block_2.out1, data=data_preview)

propertySetNames_2 = TRex.Store.IfcModel.PropertySetNames(ifcModel=ifc_pset_filter)
