# Dynamo graph IfcLoad-SceneExport.dyn (Dynamo 2.10.1.3976)
# packages: TRex 1.0.21148.41130

# group: Feature-2-classification filter
code_block = CodeBlock { "Other"; "Category"; }
byNames = TRex.Data.Canonical.ByNames(namePar0=code_block.out0, namePart1=code_block.out1)
canonical_filter = CanonicalFilterNodeModel(canonicals=byNames, MatchType=0)

# group: File logger
file_path = Filename("Out\IfcLoad-SceneExport.log")
file_logger = FileLog(fileName=file_path, LogEventLevel=1)

# group: Load IFC
file_path_2 = Filename("Ifc4\IfcSampleHouse.ifc")
ifc_load = IfcLoadStoreNodeModel(fileName=file_path_2, logger=file_logger, IsCancelable=true)  # unwired: prefs

graphicalContexts = TRex.Store.IfcModel.GraphicalContexts(ifcModel=ifc_load)

# group: Build component interim scene
code_block_2 = CodeBlock { -9.23; -2.75; -0.47; }
byXYZ = TRex.Geom.XYZs.ByXYZ(x=code_block_2.out0, y=code_block_2.out1, z=code_block_2.out2)
unit_scale = UnitScaleNodeModel(SelectedUnitScale={UnitsPerMeter: 1, Name: "Meter", Reference: "m"})
select_items_from = SelectingItemListNodeModel(items=graphicalContexts, SelectedValue=["Body"])
build_settings = SceneBuildSettingsNodeModel(offset=byXYZ, unitScale=unit_scale, providedContexts=select_items_from, TransformationStrategy=1, PositioningStrategy=1)  # unwired: featureClassificationFilter
build_scene = SceneBuildNodeModel(settings=build_settings, ifcModel=ifc_load, IsCancelable=true)

directory_path = Directory(".\Out")
relocatePath = TRex.Export.ComponentScene.RelocatePath(componentScene=build_scene, newPathName=directory_path)

# group: Export as 3DS with Y axis up
unit_scale_2 = UnitScaleNodeModel(nested=unit_scale, SelectedUnitScale={UnitsPerMeter: 39.37008, Name: "Inch", Reference: "in"})
crs_transform = CRSTransformNodeModel(Transform={Right: "PositiveX", Up: "PositiveZ", Forward: "PositiveY", Name: "Default"})  # unwired: offset
export_scene_assimp = SceneExportNodeModel(scene=relocatePath, unitScale=unit_scale_2, transform=crs_transform, Selected={ID: "3ds", Extension: "3ds", Description: "Autodesk 3DS (legacy)"}, IsCancelable=false)

# group: Logging output
log_filter = LogFilterNodeModel(logSource=export_scene_assimp, LogCount=10, LogMinSeverity=0)  # unwired: logReason
data_preview = DataTablePreviewNodeModel(in=log_filter, MinCount=1, MaxCount=100, Count=10)

save_scene = SceneSaveNodeModel(scene=relocatePath, Selected={ID: "json", Extension: "json", Description: "JSON Text"}, IsCancelable=false)  # unwired: separator

# group: Logging output
log_filter_2 = LogFilterNodeModel(logSource=save_scene, LogCount=10, LogMinSeverity=0)  # unwired: logReason
data_preview_2 = DataTablePreviewNodeModel(in=log_filter_2, MinCount=1, MaxCount=100, Count=10)
